# Grasshopper definition Snitch.gh (Grasshopper 1.0.7)
# plug-ins: Grasshopper-Tekla Link 2021.1.14, SnitchGrasshopper

mo = ModelObject(
    [null x167],
    ModelID="Snitch.db1",
    ModelObjectInfos=["Tekla.Structures.Model.Assembly, Tekla.Structures.Model, Version=2021.0.0.0, Culture=neutral, PublicKeyToken=2f04dbe497b71114;2a9a0b24-2b30-4f55-875e-6056699b7a65", "Tekla.Structures.Model.Assembly, Tekla.Structures.Model, Version=2021.0.0.0, Culture=neutral, PublicKeyToken=2f04dbe497b71114;5b2b07f3-2e87-4266-86e2-8aea8f9bdae8", "Tekla.Structures.Model.Assembly, Tekla.Structures.Model, Version=2021.0.0.0, Culture=neutral, PublicKeyToken=2f04dbe497b71114;9c5f5a10-b8a3-4b89-bd33-3c561e9ed753", "Tekla.Structures.Model.Assembly, Tekla.Structures.Model, Version=2021.0.0.0, Culture=neutral, PublicKeyToken=2f04dbe497b71114;417cfea4-24db-403d-aef3-ba30cb4f890d", "Tekla.Structures.Model.Assembly, Tekla.Structures.Model, Version=2021.0.0.0, Culture=neutral, PublicKeyToken=2f04dbe497b71114;a0a69e64-8209-49eb-9ab9-3a51e5ef31b1", "Tekla.Structures.Model.Assembly, Tekla.Structures.Model, Version=2021.0.0.0, Culture=neutral, PublicKeyToken=2f04dbe497b71114;2b013608-9cd4-47a3-b523-46ad5bb0b522"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])
mo_2 = ModelObject(simplify(graft(mo)))
deassembly = DeconstructAssembly(Assembly=mo_2)  # -> Name, Type, MainPart, Secondaries, AllObjects
plt = Plate(mo_2)
beam = Beam(mo_2)
clean = CleanTree(RemoveNulls=True, RemoveInvalid=True, RemoveEmpty=True, Tree=deassembly.Name)
clean_2 = CleanTree(RemoveNulls=True, RemoveInvalid=True, RemoveEmpty=True, Tree=beam)
clean_3 = CleanTree(RemoveNulls=True, RemoveInvalid=True, RemoveEmpty=True, Tree=plt)
debeam = DeconstructBeam(Beam=clean_2)  # -> Curve, Profile, Attributes, Position, Numbering, Deforming, Type
mesh = ConvertToMesh(TeklaObject=clean_2, SolidType=2)
deplate = DeconstructPlate(Plate=clean_3)  # -> Boundary, Profile, Attributes, Position, Numbering, Type
mesh_2 = ConvertToMesh(TeklaObject=clean_3, SolidType=2)
cp = ControlPoints(Curve=deplate.Boundary)  # -> Points, Weights, Knots
pshift = ShiftPaths(Data=mesh_2, Offset=-1)
expattributes = ExpandPartAttributes(Attributes=debeam.Attributes)  # -> Name, Profile, Material, Finish, Class, Phase, UDA
panel = Panel("PLATE")
pshift_2 = ShiftPaths(Data=cp.Points, Offset=-1)
volume = Volume(Geometry=pshift)  # -> Volume, Centroid
panel_2 = Panel("1")
cp_2 = ControlPoints(Curve=debeam.Curve)  # -> Points, Weights, Knots
pshift_3 = ShiftPaths(Data=mesh, Offset=-1)
pshift_4 = ShiftPaths(Data=cp_2.Points, Offset=-1)
tmatch = MatchText(Text=debeam.Type, Pattern="BEAM", Case=True)
tmatch_2 = MatchText(Text=debeam.Type, Pattern="COLUMN", Case=True)
volume_2 = Volume(Geometry=pshift_3)  # -> Volume, Centroid
dispatch = Dispatch(List=pshift_4, DispatchPattern=tmatch)  # -> ListA, ListB
dispatch_2 = Dispatch(List=volume_2.Volume, DispatchPattern=tmatch_2)  # -> ListA, ListB
dispatch_3 = Dispatch(List=pshift_3, DispatchPattern=tmatch)  # -> ListA, ListB
dispatch_4 = Dispatch(List=pshift_4, DispatchPattern=tmatch_2)  # -> ListA, ListB
dispatch_5 = Dispatch(List=pshift_3, DispatchPattern=tmatch_2)  # -> ListA, ListB
dispatch_6 = Dispatch(List=volume_2.Volume, DispatchPattern=tmatch_2)  # -> ListA, ListB
dispatch_7 = Dispatch(List=volume_2.Volume, DispatchPattern=tmatch)  # -> ListA, ListB
dispatch_8 = Dispatch(List=expattributes.Material, DispatchPattern=tmatch)  # -> ListA, ListB
dispatch_9 = Dispatch(List=expattributes.Material, DispatchPattern=tmatch_2)  # -> ListA, ListB
dispatch_10 = Dispatch(List=volume_2.Volume, DispatchPattern=tmatch)  # -> ListA, ListB
snitch_slab = SnitchSlab(Points=pshift_2, Volume=volume.Volume)
snitch_column = SnitchColumn(
    Mesh=dispatch_5.ListA,
    Points=dispatch_4.ListA,
    Length=dispatch_2.ListA,
    ConcreteVolume=dispatch_6.ListA,
    SteelVolume="0",
    ConcreteClass=dispatch_9.ListA)
snitch_beam = SnitchBeam(
    Mesh=dispatch_3.ListA,
    Points=dispatch.ListA,
    Length=dispatch_10.ListA,
    ConcreteVolume=dispatch_7.ListA,
    SteelVolume="0",
    ConcreteClass=dispatch_8.ListA)
merge = Merge(Data1=snitch_beam, Data2=snitch_column)  # -> flatten(Result)
snitch_building = SnitchBuilding(ListOfBuildingObjects=merge)
